# Grasshopper definition 3floor-smallbldg.gh (Grasshopper 1.0.7)
# plug-ins: Heteroptera, ItemSelector

honeybee_bldgprograms = Honeybee_bldgPrograms({"Office": 0, "Retail": 1, "MidriseApartment": 2, "PrimarySchool": 3, "SecondarySchool": 4, "SmallHotel": 5, "LargeHotel": 6, "Hospital": 7, "Outpatient": 8, "Warehouse": 9, "SuperMarket": 10, "FullServiceRestaurant": 11, "QuickServiceRestaurant": 12}, selected="Office")
listzoneprograms = Honeybee_ListZonePrograms(bldgProgram=honeybee_bldgprograms)  # -> OfficeZonePrograms; plug-in component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
honeybee_item_selector = Honeybee_ItemSelector(
    listzoneprograms,
    {"Office::BreakRoom", "Office::Storage", "Office::Vending", "Office::OpenOffice", "Office::ClosedOffice", "Office::Conference", "Office::PrintRoom", "Office::Restroom", "Office::Elec/MechRoom", "Office::IT_Room", "Office::Stair", "Office::Corridor", "Office::Lobby"}, selected="Office::OpenOffice")
getepschedules = Honeybee_GetEnergyPlusSchedules(zoneProgram=honeybee_item_selector)  # -> occupancySchedule, occupancyActivitySch, heatingSetPtSchedule, coolingSetPtSchedule, lightingSchedule, equipmentSchedule, infiltrationSchedule; plug-in component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
geteploads = Honeybee_GetEnergyPlusLoads(zoneProgram=honeybee_item_selector)  # -> equipmentLoadPerArea, infiltrationRatePerArea, lightingDensityPerArea, numOfPeoplePerArea, ventilationPerArea, ventilationPerPerson; plug-in component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
panel = Panel(honeybee_item_selector)
panel_2 = Panel([getepschedules.occupancySchedule, getepschedules.occupancyActivitySch, getepschedules.heatingSetPtSchedule, getepschedules.coolingSetPtSchedule, getepschedules.lightingSchedule, getepschedules.equipmentSchedule, getepschedules.infiltrationSchedule])
panel_3 = Panel([geteploads.equipmentLoadPerArea, geteploads.infiltrationRatePerArea, geteploads.lightingDensityPerArea, geteploads.numOfPeoplePerArea, geteploads.ventilationPerArea, geteploads.ventilationPerPerson])
convertepschvalues = Honeybee_ConvertEnergyPlusScheduleToValues(schName=getepschedules.occupancySchedule)  # -> values, holidays; plug-in component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
panel_4 = Panel(convertepschvalues.values)
_3dchart = Ladybug_3DChart(inputData=flatten(convertepschvalues.values), xScale="0.25", zScale="0")  # -> out, graphMesh, graphCurves, legend, legendBasePts, title, titleBasePts, dataPts, conditionalHOY; plug-in component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
gethbzoneeploads = Honeybee_GetZoneEnergyPlusLoads()  # -> equipmentLoadPerArea, infiltrationRatePerArea, lightingDensityPerArea, numOfPeoplePerArea, ventilationPerArea, ventilationPerPerson; plug-in component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

# ----
# Add to library
panel_5 = Panel("Expanded shale-clay")
epopaquemat = Honeybee_EnergyPlusOpaqueMaterial(name=panel_5, roughness="MediumRough", thickness="0.102", conductivity="0.535", density="1280", specificHeat="840")  # -> EPMaterial; plug-in component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
epwindowmat = Honeybee_EnergyPlusWindowMaterial(name="opaque door", U_Value="3.2", SHGC="0", VT="0")  # -> EPMaterial; plug-in component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
epwindowmat_2 = Honeybee_EnergyPlusWindowMaterial(name="double glass", U_Value="1.5", SHGC="0.3", VT="0.5")  # -> EPMaterial; plug-in component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
epconstruction = Honeybee_EnergyPlusConstruction(name="Clay tile for roof", layer_1=epopaquemat)  # -> EPConstruction; plug-in component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
epconstruction_2 = Honeybee_EnergyPlusConstruction(name="opaquedoor", layer_1=epwindowmat)  # -> EPConstruction; plug-in component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
epconstruction_3 = Honeybee_EnergyPlusConstruction(name="doubleglass", layer_1=epwindowmat_2)  # -> EPConstruction; plug-in component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
addtoeplibrary = Honeybee_AddToEnergyPlusLibrary(EPObject=[epconstruction, epconstruction_3, epconstruction_2], addToProjectLib=Toggle(True))  # -> readMe; plug-in component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
panel_6 = Panel(addtoeplibrary)

callfromepconstrlibrary = Honeybee_CallFromEPConstructionLibrary(keywords="concrete")  # -> ThermMaterials, EPMaterials, EPWindowMaterials, EPConstructions; plug-in component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
decomposeepconstruction = Honeybee_DecomposeEPConstruction(cnstrName="exterior roof")  # -> materials, comments, UValue_SI, UValue_IP, RValue_SI, RValue_IP; plug-in component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
panel_7 = Panel(callfromepconstrlibrary.EPConstructions)
panel_8 = Panel(callfromepconstrlibrary.EPMaterials)
panel_9 = Panel(decomposeepconstruction.materials)

ladybug = Ladybug_Ladybug()  # -> Vviiiiiiiiiizzz; plug-in component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
honeybee = Honeybee_Honeybee()  # -> Vviiiiiiiiiizzz; plug-in component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

brep = Brep()

# ----
# Splitting zone surface with its adjacent zone
# before surface matching,
# split the brep into their own previous brep
geo = Geometry()
intersectmass = Honeybee_IntersectMasses(bldgMassesBefore=flatten([brep, geo]))  # -> bldgMassesAfter; plug-in component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
item = ListItem(List=intersectmass, Index=2, Wrap=True)
item_2 = ListItem(List=intersectmass, Index=3, Wrap=True)
item_3 = ListItem(List=intersectmass, Index=6, Wrap=True)
item_4 = ListItem(List=intersectmass, Index=8, Wrap=True)
item_5 = ListItem(List=intersectmass, Index=1, Wrap=True)
item_6 = ListItem(List=intersectmass, Index=4, Wrap=True)
item_7 = ListItem(List=intersectmass, Index=5, Wrap=True)
item_8 = ListItem(List=intersectmass, Index=7, Wrap=True)
# DATA: Area= L x W = 6 x 7 meter= 42m^2
# Height =
# 2nd:3.3m
# 3rd:3m
# 
# #1st condition:
# 2nd:office
# 3rd:studio (5ppl= 0.11904761904 ppl/m^2, 500w= 11.9047619048 w/m^2)
# 
# #2nd condition: all:mushola 1.3ppl/m^2
item_9 = ListItem(List=intersectmass, Index=0, Wrap=True)

# ----
# Turn brep geometry into thermal zone
roof = Geometry(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)
_2ndflo = Geometry(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)
_3rdflo = Geometry(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)
spacer = Brep(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)
panel_10 = Panel("""roof
2ndflo
3rdflo
spacer""")
mass2zone = Honeybee_Masses2Zones(
    zoneMasses=flatten([roof, _2ndflo, _3rdflo, spacer]),
    zoneNames=panel_10,
    isConditioned=[Toggle(False), Toggle(True), Toggle(True), Toggle(False)],
    maxRoofAngle="60",
    createHBZones=Toggle(True))  # -> readMe, HBZones; plug-in component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
bang = ExplodeTree(Data=graft(mass2zone.HBZones))  # -> Branch0, Branch1, Branch2, Branch3

epopaquemat_2 = Honeybee_EnergyPlusOpaqueMaterial(
    name="plaster board",
    roughness="MediumSmooth",
    thickness=Slider(0.0095, range=0..0.05),
    conductivity="0.58",
    density="800",
    specificHeat="1090")  # -> EPMaterial; plug-in component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
multiplication = Multiplication(A="0.03", B=Slider(5, range=0..10))
epopaquemat_3 = Honeybee_EnergyPlusOpaqueMaterial(
    name="I02 Insulation Board",
    roughness="MediumRough",
    thickness=multiplication,
    conductivity="0.03",
    density="265",
    specificHeat="836",
    solAbsp="0.78",
    visAbsp="0.78")  # -> EPMaterial; plug-in component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
epconstruction_4 = Honeybee_EnergyPlusConstruction(
    name="Optimum wall construction",
    layer_1=epopaquemat_2,
    layer_2="M11 100MM LIGHTWEIGHT CONCRETE",
    layer_3=epopaquemat_3,
    layer_4="1/2IN Gypsum")  # -> EPConstruction; plug-in component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
panel_11 = Panel(epconstruction_4)

_2ndwindowsbig = Geometry([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])
_3rdwindowsbig = Geometry([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])

panel_12 = Panel("""3rdwindow1
3rdwindow2
3rdwindow3
3rdwindow4
3rdwindow5
3rdwindow6
3rdwindow1big
3rdwindow2big
3rdwindow3big
3rdwindow4big
3rdwindow5big
3rdwindow6big""")
_3rdwindows = Brep([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])
addhbglz = Honeybee_addHBGlz(
    HBObj=bang.Branch2,
    childSurfaces=flatten([_3rdwindows, _3rdwindowsbig]),
    childSurfacesName=flatten(panel_12),
    EPConstructions="DOUBLEGLASS")  # -> HBObjWGLZ; plug-in component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

panel_13 = Panel("""2ndwindow1
2ndwindow2
2ndwindow3
2ndwindow4
2ndwindow5
2ndwindow6
2ndwindow1big
2ndwindow2big
2ndwindow3big
2ndwindow4big
2ndwindow5big
2ndwindow6big""")
_2ndwindows = Brep([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])
addhbglz_2 = Honeybee_addHBGlz(
    HBObj=bang.Branch1,
    childSurfaces=flatten([_2ndwindows, _2ndwindowsbig]),
    childSurfacesName=flatten(panel_13),
    EPConstructions="DOUBLEGLASS")  # -> HBObjWGLZ; plug-in component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

panel_14 = Panel("""3rdopaquedoor1
3rdopaquedoor2""")
_3rddopaquedoors = Brep([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])
addhbglz_3 = Honeybee_addHBGlz(
    HBObj=addhbglz,
    childSurfaces=flatten(_3rddopaquedoors),
    childSurfacesName=flatten(panel_14),
    EPConstructions="opaquedoor")  # -> HBObjWGLZ; plug-in component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

panel_15 = Panel("""2ndopaquedoor1
2ndopaquedoor2""")
_2ndopaquedoors = Brep([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])
addhbglz_4 = Honeybee_addHBGlz(
    HBObj=addhbglz_2,
    childSurfaces=flatten(_2ndopaquedoors),
    childSurfacesName=flatten(panel_15),
    EPConstructions="opaquedoor")  # -> HBObjWGLZ; plug-in component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

toggle = BooleanToggle(True)
epoutput = Honeybee_GenerateEPOutput(
    zoneEnergyUse=toggle,
    zoneGainsAndLosses=toggle,
    zoneComfortMetrics=toggle,
    surfaceTempAnalysis="False",
    glazingSolarAnalysis=toggle)  # -> report, flatten(simulationOutputs); plug-in component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

# ----
# Defining site shading only with
# transmittance schedule
# RADmaterial will only be used if
# connected to radiance machine.
#  If not, will use transmittance with
# 0.2 reflectance
shading1 = Brep([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])
shading = Brep([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])
hb_epcontextsrf = HoneybeeEPContextSurfaces(shdSurfaces=flatten([shading, shading1]))  # -> HBContext; inputs shdSurfaces: list of Brep, justBoundingBox: Boolean
# ---------- hb_epcontextsrf: Python ----------
"""
prepare shading/context geometries

    Args:
        northVectorOrRotation: A vector that shows North or a number that shows
                               the rotation of the North from the Y axis
        bldgMasses: List of closed Breps as thermal zones.
    Returns:
        report: ...
        thermalZones: Thermal zone's geometries for visualiza
"""

ghenv.Component.Name = 'Honeybee EP context Surfaces'
ghenv.Component.NickName = 'HB_EPContextSrf'
ghenv.Component.Message = 'VER 0.0.64\nNOV_20_2018'
ghenv.Component.IconDisplayMode = ghenv.Component.IconDisplayMode.application
ghenv.Component.Category = "Honeybee"
ghenv.Component.SubCategory = "10 | Energy | Energy"
#compatibleHBVersion = VER 0.0.57\nNOV_04_2016
#compatibleLBVersion = VER 0.0.59\nFEB_01_2015
ghenv.Component.AdditionalHelpFromDocStrings = "2"

import rhinoscriptsyntax as rs
import Rhino as rc
import scriptcontext as sc
import os
import System
import Grasshopper.Kernel as gh
import uuid

tolerance = sc.doc.ModelAbsoluteTolerance
import math


def main(shdSurfaces, EPTransSchedule, meshingSettings, justBoundingBox):
    
    # import the classes
    if sc.sticky.has_key('honeybee_release'):

        try:
            if not sc.sticky['honeybee_release'].isCompatible(ghenv.Component): return -1
            if sc.sticky['honeybee_release'].isInputMissing(ghenv.Component): return -1
        except:
            warning = "You need a newer version of Honeybee to use this compoent." + \
            " Use updateHoneybee component to update userObjects.\n" + \
            "If you have already updated userObjects drag Honeybee_Honeybee component " + \
            "into canvas and try again."
            w = gh.GH_RuntimeMessageLevel.Warning
            ghenv.Component.AddRuntimeMessage(w, warning)
            return -1
        
        # don't customize this part
        hb_EPSrf = sc.sticky["honeybee_EPSurface"]
        hb_EPSHDSurface = sc.sticky["honeybee_EPShdSurface"]
        hb_RADMaterialAUX = sc.sticky["honeybee_RADMaterialAUX"]
        hb_EPObjectsAux = sc.sticky["honeybee_EPObjectsAUX"]()
        HBScheduleList = sc.sticky["honeybee_ScheduleLib"].keys()

        ########################################################################
        #----------------------------------------------------------------------#
        shdBreps = []
        # create bounding box of shading geometries
        if justBoundingBox:
            for brep in shdSurfaces:
                if brep.Faces.Count>1 or not brep.Faces[0].IsPlanar(sc.doc.ModelAbsoluteTolerance):
                    shdBreps.append(brep.GetBoundingBox(True).ToBrep())
                else:
                    shdBreps.append(brep)
        else:
            shdBreps = shdSurfaces
        
        shadingClasses = []
        shadingMeshPreview = []
        
        if meshingSettings == None:
            mp = rc.Geometry.MeshingParameters.Minimal
            mp.SimplePlanes = True
        else:
            mp = meshingSettings
        
        def getRadMaterialName(radMaterial):
            nameStr = radMaterial.split(" ")[2]
            name =  nameStr.split("\n")[0]
            return name
        
        for brepCount, brep in enumerate(shdBreps):
            if brep != None:
                isPlanar = True
                # check planarity
                for face in brep.Faces:
                    if not face.IsPlanar(tolerance):
                        isPlanar = False
                        break
                
                shadingBreps = []
                if not isPlanar:
                    meshArray = rc.Geometry.Mesh.CreateFromBrep(brep, mp)
                    for mesh in meshArray:
                        for meshFace in range(mesh.Faces.Count):
                            vertices = list(mesh.Faces.GetFaceVertices(meshFace))[1:]
                            vertices = vertices + [sc.doc.ModelAbsoluteTolerance]
                            # create the brep from mesh
                            shdBrep = rc.Geometry.Brep.CreateFromCornerPoints(*vertices)
                            shadingBreps.append(shdBrep)
                else:
                    for face in brep.Faces:
                        shadingBreps.append(face.DuplicateFace(False))
                
                for faceCount, shdBrep in enumerate(shadingBreps):
                        thisShading = hb_EPSHDSurface(shdBrep, 1000*brepCount + faceCount, 'shdSrf_' + `brepCount` + '_' + `faceCount` + "_" + str(uuid.uuid4()))
                        
                        # add transmittance schedule if any
                        if EPTransSchedule!=None:
                            schedule= EPTransSchedule.upper()
                            if schedule!=None and not schedule.lower().endswith(".csv") and schedule not in HBScheduleList:
                                msg = "Cannot find " + schedule + " in Honeybee schedule library."
                                print msg
                                ghenv.Component.AddRuntimeMessage(gh.GH_RuntimeMessageLevel.Warning, msg)
                                return -1
                            elif schedule!=None and schedule.lower().endswith(".csv"):
                                # check if csv file is existed
                                if not os.path.isfile(schedule):
                                    msg = "Cannot find the shchedule file: " + schedule
                                    print msg
                                    ghenv.Component.AddRuntimeMessage(gh.GH_RuntimeMessageLevel.Warning, msg)
                                    return -1
                            
                            thisShading.TransmittanceSCH = schedule
                        
                        # add the Rad Material if any
                        if RADMaterial!=None:
                            # if it is just the name of the material make sure it is already defined
                            if len(RADMaterial.split(" ")) == 1:
                                # if the material is not in the library add it to the library
                                if not hb_RADMaterialAUX.isMatrialExistInLibrary(RADMaterial):
                                    warningMsg = "Can't find " + RADMaterial + " in RAD Material Library.\n" + \
                                                "Add the material to the library and try again."
                                    ghenv.Component.AddRuntimeMessage(gh.GH_RuntimeMessageLevel.Warning, warningMsg)
                                    return
                                
                                try:
                                    thisShading.setRADMaterial(RADMaterial)
                                except Exception, e:
                                    print e
                                    warningMsg = "You are using an old version of Honeybee_Honeybee! Update your files and try again."
                                    print warningMsg
                                    ghenv.Component.AddRuntimeMessage(gh.GH_RuntimeMessageLevel.Warning, warningMsg)
                                    return
                                
                                addedToLib = True
                            else:
                                
                                # try to add the material to the library
                                addedToLib, thisShading.RadMaterial = hb_RADMaterialAUX.analyseRadMaterials(RADMaterial, True)
                                
                            if addedToLib==False:
                                warningMsg = "Failed to add " + RADMaterial + " to the Library."
                                ghenv.Component.AddRuntimeMessage(gh.GH_RuntimeMessageLevel.Warning, warningMsg)
                                return
                        
                        # add shading to the list
                        shadingClasses.append(thisShading)
                
        # add to the hive
        hb_hive = sc.sticky["honeybee_Hive"]()
        HBContext  = hb_hive.addToHoneybeeHive(shadingClasses, ghenv.Component)
        return HBContext
        ################################################################################################
    else:
        print "You should first let Honeybee to fly..."
        w = gh.GH_RuntimeMessageLevel.Warning
        ghenv.Component.AddRuntimeMessage(w, "You should first let Honeybee to fly...")
        return -1
        

if _shdSurfaces and _shdSurfaces[0]!=None:
    # add cleaning function
    result= main(_shdSurfaces, EPTransSchedule_, meshingSettings_, justBoundingBox_)
    
    if result != -1: HBContext = result
# ---------- end hb_epcontextsrf ----------

panel_16 = Panel("""1
1
1
1
1
1
1
1
1
1
1
1
1
1
1
1
1
1
1
1
1
1
1
1""")

# ----
# Solve Adjacencies, need to convert brep
# into thermal zone before this
toggle_2 = BooleanToggle(True)
solveadjc = Honeybee_SolveAdjacencies(HBZones=flatten([bang.Branch0, addhbglz_4, addhbglz_3, bang.Branch3]), removeCurrentAdjc=toggle_2, findAdjc=toggle_2)  # -> readMe, HBZonesWADJ; plug-in component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

# ----
# Checking boundary condition for the
# adjacent thermal zone
# with surface attribute
srfattributelist = Honeybee_SurfaceAttributeList({"Name": "name", "Radiance Material": "RadMaterial", "EnergyPlus Construction": "EPConstruction", "Surface Type": "type", "Boundary Condition": "BC", "BC Object": "BCObject", "Sun Exposure": "sunExposure", "Wind Exposure": "windExposure", "Has Child Surface": "hasChild", "Is Child Surface": "isChild", "Is Planar": "isPlanar", "Srf Type Set By User": "srfTypeByUser", "Boundary Condition Set By User": "srfBCByUser", "Shade Material Name": "shadeMaterialName", "Shading Control Name": "shadingControlName", "Shcading Schedule Name": "shadingSchName"}, selected="Boundary Condition")
labelsurfaces = Honeybee_LabelZoneSurfaces(HBObjects=flatten(solveadjc.HBZonesWADJ), attribute=srfattributelist)  # -> surfaceTxtLabels, labelBasePts, brepTxtLabels, surfaceWireFrames; plug-in component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

panel_17 = Panel("""0
0
0
0
0
0
0
0
0
0
0
0
0
0
0
0
0
0
0
0
0
0
0
0""")
toggle_3 = BooleanToggle(True)
dup = DuplicateData(Data=panel_16, Number="364", Order=True)

setepzonecnstr = Honeybee_SetEPZoneConstruction(HBZones=flatten(solveadjc.HBZonesWADJ), wallEPConstruction=epconstruction_4, roofEPConstruction="EXTERIOR ROOF")  # -> simplify(modifiedHBZones); plug-in component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

dup_2 = DuplicateData(Data=panel_17, Number="1", Order=True)
simcontrol = Honeybee_SimulationControl(
    doZoneSizingCalculation=toggle_3,
    doSystemSizingCalculation=toggle_3,
    doPlantSizingCalculation=toggle_3,
    runSimForSizingPeriods=Toggle(False),
    runSimForRunPeriods=toggle_3)  # -> simControls; plug-in component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
csvschedule = Honeybee_CreateCSVSchedule(values=[dup, dup_2], scheduleName="COOLING AVAILABILITY", writeFile=Toggle(True))  # -> readMe, csvSchedule; plug-in component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
coolingdetails = Honeybee_HVACCoolingDetails(coolingAvailSched=csvschedule.csvSchedule)  # -> coolingDetails; plug-in component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
panel_18 = Panel(epoutput.simulationOutputs)

decomposebytype = Honeybee_DecomposeBasedOnType(HBZone=solveadjc.HBZonesWADJ)  # -> walls, interiorWalls, airWalls, windows, interiorWindows, skylights, roofs, ceilings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; plug-in component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
preview = CustomPreview(Geometry=decomposebytype.ceilings, Material=ColourSwatch(SwatchColor=RGB(102, 83, 70)))
preview_2 = CustomPreview(Geometry=decomposebytype.windows, Material=ColourSwatch(SwatchColor=RGBA(22, 190, 199, 158)))
preview_3 = CustomPreview(Geometry=decomposebytype.interiorWalls, Material=ColourSwatch(SwatchColor=RGB(126, 199, 38)))
preview_4 = CustomPreview(Geometry=decomposebytype.airWalls, Material=ColourSwatch(SwatchColor=RGB(38, 34, 31)))
preview_5 = CustomPreview(Geometry=decomposebytype.walls, Material=ColourSwatch(SwatchColor=RGB(199, 113, 38)))
preview_6 = CustomPreview(Geometry=decomposebytype.roofs, Material=ColourSwatch(SwatchColor=RGB(255, 110, 0)))

energysimpar = Honeybee_EnergySimulationPar(timestep=6, solarDistribution="4", simulationControls=simcontrol, ddyFile="C:\ladybug\resources\Jakarta_Downtown.ddy")  # -> energySimPar; plug-in component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
bang_2 = ExplodeTree(Data=graft(setepzonecnstr))  # -> Branch0, Branch1, Branch2, Branch3
_2ndfloor = Geometry(bang_2.Branch1)
_3rdfloor = Geometry(bang_2.Branch2)
roof_2 = Geometry(bang_2.Branch0)
spacer_2 = Geometry(bang_2.Branch3)

setepzoneloads = Honeybee_SetEnergyPlusZoneLoads(
    HBZones=[_2ndfloor, spacer_2],
    equipmentLoadPerArea="16.791779",
    infiltrationRatePerArea="0.000227",
    lightingDensityPerArea="11.9047619048 ",
    numOfPeoplePerArea="0.11904761904 ",
    ventilationPerArea="0",
    ventilationPerPerson="0.0025")  # -> loads, HBZones; plug-in component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
setepzoneloads_2 = Honeybee_SetEnergyPlusZoneLoads(
    HBZones=[roof_2, _3rdfloor, spacer_2],
    equipmentLoadPerArea="7.642412",
    infiltrationRatePerArea="0.000227",
    lightingDensityPerArea="11.840357",
    numOfPeoplePerArea="0.056511",
    ventilationPerArea="0.000305",
    ventilationPerPerson="0.00236")  # -> loads, HBZones; plug-in component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
setepzoneloads_3 = Honeybee_SetEnergyPlusZoneLoads(
    HBZones=[bang_2.Branch0, bang_2.Branch1, bang_2.Branch2, bang_2.Branch3],
    equipmentLoadPerArea="48.007266",
    infiltrationRatePerArea="0.000227",
    lightingDensityPerArea="12.916753",
    numOfPeoplePerArea="0.538198",
    ventilationPerArea="0.000305",
    ventilationPerPerson="0.00236")  # -> loads, HBZones; plug-in component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
hvacsystemslist = Honeybee_HVACSystemsList({"-1. Thermostat Only": -1, "0. Ideal Air Loads": 0, "1. PTAC | Residential": 1, "2. PTHP | Residential": 2, "3. Packaged Single Zone - AC": 3, "4. Packaged Single Zone - HP": 4, "5. Packaged VAV w/ Reheat": 5, "6. Packaged VAV w/ PFP Boxes": 6, "7. VAV w/ Reheat": 7, "8. VAV w/ PFP Boxes": 8, "9. Warm Air Furnace - Gas Fired": 9, "10.Warm Air Furnace - Electric": 10, "11.Fan Coil Units + DOAS": 11, "12.Active Chilled Beams + DOAS": 12, "13.Radiant Floors + DOAS": 13, "14.Custom Rad Surfaces + DOAS": 14, "15.Heated Surfaces + VAV Cooling": 15, "16.VRF + DOAS": 16, "17.WSHP + DOAS": 17}, selected="2. PTHP | Residential")
hvacsystemslist_2 = Honeybee_HVACSystemsList({"-1. Thermostat Only": -1, "0. Ideal Air Loads": 0, "1. PTAC | Residential": 1, "2. PTHP | Residential": 2, "3. Packaged Single Zone - AC": 3, "4. Packaged Single Zone - HP": 4, "5. Packaged VAV w/ Reheat": 5, "6. Packaged VAV w/ PFP Boxes": 6, "7. VAV w/ Reheat": 7, "8. VAV w/ PFP Boxes": 8, "9. Warm Air Furnace - Gas Fired": 9, "10.Warm Air Furnace - Electric": 10, "11.Fan Coil Units + DOAS": 11, "12.Active Chilled Beams + DOAS": 12, "13.Radiant Floors + DOAS": 13, "14.Custom Rad Surfaces + DOAS": 14, "15.Heated Surfaces + VAV Cooling": 15, "16.VRF + DOAS": 16, "17.WSHP + DOAS": 17}, selected="2. PTHP | Residential")
hvacsystemslist_3 = Honeybee_HVACSystemsList({"-1. Thermostat Only": -1, "0. Ideal Air Loads": 0, "1. PTAC | Residential": 1, "2. PTHP | Residential": 2, "3. Packaged Single Zone - AC": 3, "4. Packaged Single Zone - HP": 4, "5. Packaged VAV w/ Reheat": 5, "6. Packaged VAV w/ PFP Boxes": 6, "7. VAV w/ Reheat": 7, "8. VAV w/ PFP Boxes": 8, "9. Warm Air Furnace - Gas Fired": 9, "10.Warm Air Furnace - Electric": 10, "11.Fan Coil Units + DOAS": 11, "12.Active Chilled Beams + DOAS": 12, "13.Radiant Floors + DOAS": 13, "14.Custom Rad Surfaces + DOAS": 14, "15.Heated Surfaces + VAV Cooling": 15, "16.VRF + DOAS": 16, "17.WSHP + DOAS": 17}, selected="2. PTHP | Residential")
hvacsystem = Honeybee_AssignHVACSystem(HBZones=flatten(setepzoneloads_3.HBZones), HVACSystems=hvacsystemslist, coolingDetails=coolingdetails)  # -> readMe, simplify(HBZones); plug-in component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
hvacsystem_2 = Honeybee_AssignHVACSystem(HBZones=flatten(setepzoneloads_2.HBZones), HVACSystems=hvacsystemslist_2, coolingDetails=coolingdetails)  # -> readMe, simplify(HBZones); plug-in component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
hvacsystem_3 = Honeybee_AssignHVACSystem(HBZones=flatten(setepzoneloads.HBZones), HVACSystems=hvacsystemslist_3, coolingDetails=coolingdetails)  # -> readMe, simplify(HBZones); plug-in component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
mushola = Panel(hvacsystem.readMe)
_2ndfloor_2 = Panel(hvacsystem_2.readMe)
_3rdfloor_2 = Panel(hvacsystem_3.readMe)
conditionedunconditioned = Honeybee_SeparateConditionedAndUnconditionedZones(HBZones=flatten(hvacsystem_2.HBZones))  # -> conditionedZones, unconditionedZones; plug-in component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
conditionedunconditioned_2 = Honeybee_SeparateConditionedAndUnconditionedZones(HBZones=flatten(hvacsystem_3.HBZones))  # -> conditionedZones, unconditionedZones; plug-in component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
conditionedunconditioned_3 = Honeybee_SeparateConditionedAndUnconditionedZones(HBZones=flatten(hvacsystem.HBZones))  # -> conditionedZones, unconditionedZones; plug-in component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

# ----
# Run EnergyPlus then Export to OpenStudio
panel_19 = Panel("C:\ladybug\resources\Jakarta_Downtown.epw")
panel_20 = Panel("C:\Users\Shiro\Desktop\workspace\latihan")
toggle_4 = BooleanToggle(False)
toggle_5 = BooleanToggle(False)
toggle_6 = BooleanToggle(True)
toggle_7 = BooleanToggle(True)
exporttoopenstudio = Honeybee_ExportToOpenStudio(
    epwWeatherFile=panel_19,
    energySimPar=energysimpar,
    HBZones=flatten(hvacsystem_2.HBZones),
    HBContext=flatten(hb_epcontextsrf),
    simulationOutputs=flatten(epoutput.simulationOutputs),
    writeOSM=toggle_6,
    runSimulation=toggle_7,
    fileName="2ndfloor_office",
    workingDir=panel_20)  # -> readMe, osmFileAddress, idfFileAddress, resultFileAddress, eioFileAddress, rddFileAddress, htmlReport, studyFolder, model; plug-in component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
exporttoopenstudio_2 = Honeybee_ExportToOpenStudio(
    epwWeatherFile=panel_19,
    energySimPar=energysimpar,
    HBZones=flatten(hvacsystem_3.HBZones),
    HBContext=flatten(hb_epcontextsrf),
    simulationOutputs=flatten(epoutput.simulationOutputs),
    writeOSM=toggle_6,
    runSimulation=toggle_7,
    fileName="3rdfloor_studio",
    workingDir=panel_20)  # -> readMe, osmFileAddress, idfFileAddress, resultFileAddress, eioFileAddress, rddFileAddress, htmlReport, studyFolder, model; plug-in component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
exporttoopenstudio_3 = Honeybee_ExportToOpenStudio(
    epwWeatherFile=panel_19,
    energySimPar=energysimpar,
    HBZones=flatten(hvacsystem.HBZones),
    HBContext=flatten(hb_epcontextsrf),
    simulationOutputs=flatten(epoutput.simulationOutputs),
    writeOSM=toggle_6,
    runSimulation=toggle_7,
    fileName="2ndcondition_mushola",
    workingDir=panel_20)  # -> readMe, osmFileAddress, idfFileAddress, resultFileAddress, eioFileAddress, rddFileAddress, htmlReport, studyFolder, model; plug-in component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
readeio = Honeybee_ReadHVACSizing(eioFile=exporttoopenstudio_3.eioFileAddress)  # -> zonePeakLoadObjs, zonePeakLoadVals, zoneSizingObjs, zoneSizingValues, systemSizingObjs, systemSizingVals, componentSizObjs, componentSizVals, coolDesignDayLoad, heatDesignDayLoad; plug-in component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
panel_21 = Panel(exporttoopenstudio_3.resultFileAddress)
readeio_2 = Honeybee_ReadHVACSizing(eioFile=exporttoopenstudio_2.eioFileAddress)  # -> zonePeakLoadObjs, zonePeakLoadVals, zoneSizingObjs, zoneSizingValues, systemSizingObjs, systemSizingVals, componentSizObjs, componentSizVals, coolDesignDayLoad, heatDesignDayLoad; plug-in component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
readeio_3 = Honeybee_ReadHVACSizing(eioFile=exporttoopenstudio.eioFileAddress)  # -> zonePeakLoadObjs, zonePeakLoadVals, zoneSizingObjs, zoneSizingValues, systemSizingObjs, systemSizingVals, componentSizObjs, componentSizVals, coolDesignDayLoad, heatDesignDayLoad; plug-in component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
panel_22 = Panel(exporttoopenstudio_2.resultFileAddress)
panel_23 = Panel(exporttoopenstudio.resultFileAddress)
flrnorm = Honeybee_NormalizeDataByFloorArea(simData=readeio.zoneSizingValues, HBZones=flatten(hvacsystem.HBZones))  # -> totNormData, zoneNormData; plug-in component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
flrnorm_2 = Honeybee_NormalizeDataByFloorArea(simData=readeio_2.zoneSizingValues, HBZones=flatten(hvacsystem_3.HBZones))  # -> totNormData, zoneNormData; plug-in component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
flrnorm_3 = Honeybee_NormalizeDataByFloorArea(simData=readeio_3.zoneSizingValues, HBZones=flatten(hvacsystem_2.HBZones))  # -> totNormData, zoneNormData; plug-in component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
panel_24 = Panel(flrnorm.totNormData)
panel_25 = Panel(flrnorm_2.totNormData)
panel_26 = Panel(flrnorm_3.totNormData)

# ----
# 1st Condition
# 2nd floor = office
readepresult = Honeybee_ReadEPResult(resultFileAddress=exporttoopenstudio.resultFileAddress)  # -> port, port_2, cooling, heating, electricLight, electricEquip, fanElectric, port_3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; plug-in component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
strnum = Ladybug_SeparateData(inputList=flatten(readepresult.meanRadTemperature))  # -> numbers, strings; plug-in component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
panel_27 = Panel(readepresult.heating)
flrnorm_4 = Honeybee_NormalizeDataByFloorArea(simData=readepresult.heating, HBZones=flatten(conditionedunconditioned.conditionedZones))  # -> totNormData, zoneNormData; plug-in component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
extremums = MinMax(Number=strnum.numbers)  # -> Minimum, Maximum
panel_28 = Panel(flrnorm_4.totNormData)
panel_29 = Panel(extremums.Maximum)
panel_30 = Panel(extremums.Minimum)
strnum_2 = Ladybug_SeparateData(inputList=flatten(panel_28))  # -> numbers, strings; plug-in component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
ma = MassAddition(Input=strnum_2.numbers)  # -> Result, PartialResults
cooling_consumption_kwh_year = Panel(ma.Result)

# ----
# 2nd Condition
# 2nd floor = mushola
# 3rd floor = mushola
readepresult_2 = Honeybee_ReadEPResult(resultFileAddress=exporttoopenstudio_3.resultFileAddress)  # -> port, port_2, cooling, heating, electricLight, electricEquip, fanElectric, port_3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; plug-in component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
strnum_3 = Ladybug_SeparateData(inputList=flatten(readepresult_2.meanRadTemperature))  # -> numbers, strings; plug-in component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
panel_31 = Panel(readepresult_2.heating)
flrnorm_5 = Honeybee_NormalizeDataByFloorArea(simData=readepresult_2.heating, HBZones=flatten(conditionedunconditioned_3.conditionedZones))  # -> totNormData, zoneNormData; plug-in component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
extremums_2 = MinMax(Number=strnum_3.numbers)  # -> Minimum, Maximum
panel_32 = Panel(flrnorm_5.totNormData)
panel_33 = Panel(extremums_2.Maximum)
panel_34 = Panel(extremums_2.Minimum)
strnum_4 = Ladybug_SeparateData(inputList=flatten(panel_32))  # -> numbers, strings; plug-in component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
ma_2 = MassAddition(Input=strnum_4.numbers)  # -> Result, PartialResults
cooling_consumption_kwh_year_2 = Panel(ma_2.Result)

# ----
# 1st Condition
# 3rd floor = studio
readepresult_3 = Honeybee_ReadEPResult(resultFileAddress=exporttoopenstudio_2.resultFileAddress)  # -> port, port_2, cooling, heating, electricLight, electricEquip, fanElectric, port_3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; plug-in component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
strnum_5 = Ladybug_SeparateData(inputList=flatten(readepresult_3.meanRadTemperature))  # -> numbers, strings; plug-in component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
panel_35 = Panel(readepresult_3.heating)
flrnorm_6 = Honeybee_NormalizeDataByFloorArea(simData=readepresult_3.heating, HBZones=flatten(conditionedunconditioned_2.conditionedZones))  # -> totNormData, zoneNormData; plug-in component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
extremums_3 = MinMax(Number=strnum_5.numbers)  # -> Minimum, Maximum
panel_36 = Panel(flrnorm_6.totNormData)
panel_37 = Panel(extremums_3.Maximum)
panel_38 = Panel(extremums_3.Minimum)
strnum_6 = Ladybug_SeparateData(inputList=flatten(panel_36))  # -> numbers, strings; plug-in component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
ma_3 = MassAddition(Input=strnum_6.numbers)  # -> Result, PartialResults
cooling_consumption_kwh_year_3 = Panel(ma_3.Result)

# ----
# ANALIZE RESULTS (Annual)
readepresult_4 = Honeybee_ReadEPResult(resultFileAddress=exporttoopenstudio.resultFileAddress)  # -> port, port_2, cooling, heating, electricLight, electricEquip, fanElectric, port_3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; plug-in component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
strnum_7 = Ladybug_SeparateData(inputList=flatten(readepresult_4.cooling))  # -> numbers, strings; plug-in component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
strnum_8 = Ladybug_SeparateData(inputList=flatten([readepresult_4.cooling, readepresult_4.heating]))  # -> numbers, strings; plug-in component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
strnum_9 = Ladybug_SeparateData(inputList=flatten(readepresult_4.heating))  # -> numbers, strings; plug-in component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
strnum_10 = Ladybug_SeparateData(inputList=flatten(readepresult_4.fanElectric))  # -> numbers, strings; plug-in component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
graph = QuickGraph(strnum_8.numbers, SortOrder=0)
ma_4 = MassAddition(Input=flatten(strnum_10.numbers))  # -> Result, PartialResults
ma_5 = MassAddition(Input=flatten(strnum_7.numbers))  # -> Result, PartialResults
ma_6 = MassAddition(Input=flatten(strnum_9.numbers))  # -> Result, PartialResults
ma_7 = MassAddition(Input=[ma_5.Result, ma_6.Result, ma_4.Result])  # -> Result, PartialResults
round = Round(Number=ma_4.Result)  # -> Nearest, Floor, Ceiling
round_2 = Round(Number=ma_6.Result)  # -> Nearest, Floor, Ceiling
round_3 = Round(Number=ma_5.Result)  # -> Nearest, Floor, Ceiling
round_4 = Round(Number=ma_7.Result)  # -> Nearest, Floor, Ceiling
concat = Concatenate(FragmentA="_CoolingEnergy_", FragmentB=round_3.Ceiling)
concat_2 = Concatenate(FragmentA="_HeatingEnergy_", FragmentB=round_2.Ceiling)
concat_3 = Concatenate(FragmentA="_LightingEnergy_", FragmentB=round.Ceiling)
concat_4 = Concatenate(FragmentA="_TotalEnergy_", FragmentB=round_4.Ceiling)
panel_39 = Panel([concat, concat_2, concat_3, concat_4])

readepresult_5 = Honeybee_ReadEPResult(resultFileAddress=exporttoopenstudio_2.resultFileAddress)  # -> port, port_2, cooling, heating, electricLight, electricEquip, fanElectric, port_3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; plug-in component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
strnum_11 = Ladybug_SeparateData(inputList=flatten([readepresult_5.cooling, readepresult_5.heating]))  # -> numbers, strings; plug-in component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
strnum_12 = Ladybug_SeparateData(inputList=flatten(readepresult_5.cooling))  # -> numbers, strings; plug-in component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
strnum_13 = Ladybug_SeparateData(inputList=flatten(readepresult_5.fanElectric))  # -> numbers, strings; plug-in component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
strnum_14 = Ladybug_SeparateData(inputList=flatten(readepresult_5.heating))  # -> numbers, strings; plug-in component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
ma_8 = MassAddition(Input=flatten(strnum_13.numbers))  # -> Result, PartialResults
ma_9 = MassAddition(Input=flatten(strnum_14.numbers))  # -> Result, PartialResults
ma_10 = MassAddition(Input=flatten(strnum_12.numbers))  # -> Result, PartialResults
graph_2 = QuickGraph(strnum_11.numbers, SortOrder=0)
ma_11 = MassAddition(Input=[ma_10.Result, ma_9.Result, ma_8.Result])  # -> Result, PartialResults
round_5 = Round(Number=ma_8.Result)  # -> Nearest, Floor, Ceiling
round_6 = Round(Number=ma_9.Result)  # -> Nearest, Floor, Ceiling
round_7 = Round(Number=ma_10.Result)  # -> Nearest, Floor, Ceiling
round_8 = Round(Number=ma_11.Result)  # -> Nearest, Floor, Ceiling
concat_5 = Concatenate(FragmentA="_CoolingEnergy_", FragmentB=round_7.Ceiling)
concat_6 = Concatenate(FragmentA="_HeatingEnergy_", FragmentB=round_6.Ceiling)
concat_7 = Concatenate(FragmentA="_FanEnergy_", FragmentB=round_5.Ceiling)
concat_8 = Concatenate(FragmentA="_TotalEnergy_", FragmentB=round_8.Ceiling)
panel_40 = Panel([concat_5, concat_6, concat_7, concat_8])

readepresult_6 = Honeybee_ReadEPResult(resultFileAddress=exporttoopenstudio_3.resultFileAddress)  # -> port, port_2, cooling, heating, electricLight, electricEquip, fanElectric, port_3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; plug-in component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
strnum_15 = Ladybug_SeparateData(inputList=flatten([readepresult_6.cooling, readepresult_6.heating]))  # -> numbers, strings; plug-in component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
strnum_16 = Ladybug_SeparateData(inputList=flatten(readepresult_6.cooling))  # -> numbers, strings; plug-in component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
strnum_17 = Ladybug_SeparateData(inputList=flatten(readepresult_6.fanElectric))  # -> numbers, strings; plug-in component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
strnum_18 = Ladybug_SeparateData(inputList=flatten(readepresult_6.heating))  # -> numbers, strings; plug-in component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
ma_12 = MassAddition(Input=flatten(strnum_17.numbers))  # -> Result, PartialResults
ma_13 = MassAddition(Input=flatten(strnum_18.numbers))  # -> Result, PartialResults
ma_14 = MassAddition(Input=flatten(strnum_16.numbers))  # -> Result, PartialResults
graph_3 = QuickGraph(strnum_15.numbers, SortOrder=0)
ma_15 = MassAddition(Input=[ma_14.Result, ma_13.Result, ma_12.Result])  # -> Result, PartialResults
round_9 = Round(Number=ma_12.Result)  # -> Nearest, Floor, Ceiling
round_10 = Round(Number=ma_13.Result)  # -> Nearest, Floor, Ceiling
round_11 = Round(Number=ma_14.Result)  # -> Nearest, Floor, Ceiling
round_12 = Round(Number=ma_15.Result)  # -> Nearest, Floor, Ceiling
concat_9 = Concatenate(FragmentA="_CoolingEnergy_", FragmentB=round_11.Ceiling)
concat_10 = Concatenate(FragmentA="_HeatingEnergy_", FragmentB=round_10.Ceiling)
concat_11 = Concatenate(FragmentA="_FanEnergy_", FragmentB=round_9.Ceiling)
concat_12 = Concatenate(FragmentA="_TotalEnergy_", FragmentB=round_12.Ceiling)
panel_41 = Panel([concat_9, concat_10, concat_11, concat_12])

subtraction = Subtraction(A=round_8.Ceiling, B=round_4.Ceiling)
division = Division(A=subtraction, B=round_4.Ceiling)
multiplication_2 = Multiplication(A=division, B="10000")
round_13 = Round(Number=multiplication_2)  # -> Nearest, Floor, Ceiling
division_2 = Division(A=round_13.Ceiling, B="100")
concat_13 = Concatenate(FragmentA=division_2, FragmentB="% change in energy demand")
panel_42 = Panel(concat_13)
